# Requirement set Reqts_StandardisedFileHeader (R2020a)
This is the requirements specification module for the function to create a Standardised File Header

## 1 [#1] File Name
The utility shall request a filename from the user.

## 2 [#5] Path
The utility shall request the destination folder

## 3 [#4] Camel Case
The name shall be reformatted to be in camel case

## 4 [#3] Create file
The utility shall create a new file with a filename as previously specified.

## 5 [#2] Title Line
The first line of the file shall be the title.
The title line will be in the format:
%% Short title