% Requirement links of StandardisedFileHeader.m (R2020b)

% lines 34-35 relates to Reqts_StandardisedFileHeader.slreqx#1: File Name
                        functionName, ...
                        path)

% line 42 relates to Reqts_StandardisedFileHeader.slreqx#4: Camel Case
% Convert to camel case (if appropriate)

% lines 53-86 relates to Reqts_StandardisedFileHeader.slreqx#2: Title Line
fid = fopen(path + "\" + functionName + ".m", 'wt');

% Create the title line
fprintf(fid, '%%%% %s \n', functionName);

fprintf(fid, '%s \n', '% The purpose of this script is to ... ');
fprintf(fid, '%s \n', '% TODO: Populate the description ... ');
fprintf(fid, '%s \n', '%% FUNCTIONAL INPUTS');
fprintf(fid, '%s \n', '% This function / script accepts the following input(s):');
fprintf(fid, '%s \n', '% Input 1: <Input 1 Name>');
fprintf(fid, '     %s \n', '% Dimensions: Input variable dimensions');
fprintf(fid, '     %s \n', '% Data Type: Input data type');
fprintf(fid, '     %s \n', '% Other comments / information:');

fprintf(fid, '%s \n', '%% FUNCTIONAL OUTPUTS');
fprintf(fid, '%s \n', '% This function / script produces the following output(s):');
fprintf(fid, '%s \n', '% Output 1: Output 1 Name');
fprintf(fid, '     %s \n', '% Dimensions: Output variable dimensions');
fprintf(fid, '     %s \n', '% Data Type: Output data type');
fprintf(fid, '     %s \n', '% Other comments / information:');

fprintf(fid, '%s \n', '%% OTHER OUTPUTS');
fprintf(fid, '%s \n', '% In addition to the functional output(s) described above, this function / script also produces the following other outputs:');
fprintf(fid, '%s \n', '% Other Output 1: e.g logfile.txt');
fprintf(fid, '     %s \n', '% Dimensions: Output variable dimensions');
fprintf(fid, '     %s \n', '% Data Type: Output data type');
fprintf(fid, '     %s \n', '% Other comments / information:');

% Create a "links" section
fprintf(fid, '%s \n', '%% LINKS');
fprintf(fid, '%s \n', '% For further information check out: <a href="matlab:web("https://github.com/cavediverchris/")">Git documentation</a>.'); 
fprintf(fid, '%s \n', '% TODO: Populate any relevent external links ... ');

%% Close the file for editing